# Dynamo graph export_revit_link_data.dyn (Dynamo 2.19.3.6394)

file_path = Filename(".\export_revit_link_data.py")
file_from_path = FileObject(path=file_path)
readText = FileSystem.ReadText(file=file_from_path)
python_script_from_string = PythonStringNode(script=readText)  # CPython3; unwired: IN[0]
